# Grasshopper definition MPDA22-session04_hops.gh (Grasshopper 1.0.7)
# plug-ins: Kangaroo2 Components, Hops, Anemone

number_slider = Slider(2, range=1..2)  # disabled
number_slider_2 = Slider(1, range=0..2)  # disabled
subd = SubD(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)  # disabled
meshsubd = MeshFromSubD(SubD=subd, Density=number_slider_2)  # disabled
triremesh = TriRemesh(Geometry=meshsubd, Length=number_slider, Iterations=25)  # -> Triangulation, Dual, Creases; disabled
panel = Panel("http://127.0.0.1:5000")  # disabled
panel_2 = Panel("/shortestpath")  # disabled
data = Data(triremesh.Triangulation)  # disabled
data_2 = Data(meshsubd)  # disabled
number_slider_3 = Slider(33, range=0..100)  # disabled
clean = CombineClean(Meshes=data_2)  # disabled
concat = Concatenate(FragmentA=panel, FragmentB=panel_2)  # disabled
clean_2 = CombineClean(Meshes=data_2)  # disabled
python = GhPythonScript(M=clean_2)  # -> out, a; inputs M: Mesh; disabled
# ---------- python: Python ----------
a = M.Faces.Count
# ---------- end python ----------
concat_2 = Concatenate(FragmentA="http://127.0.0.1:5000", FragmentB="/shortestpath")
loop_start = LoopStart(Repeat=number_slider_3, Trigger=number_slider_3, Data=clean_2)  # -> port, Counter, Data; disabled
number_slider_4 = Slider(7, range=0..10)  # disabled
number_slider_5 = Slider(4, range=0..10)  # disabled
data_3 = Data(loop_start.Data)  # disabled
button = Button()
concat_3 = Concatenate(FragmentA="http://127.0.0.1:5000", FragmentB="/meshgraph")
explodemesh = GhPythonScript(m=clean)  # -> out, a; inputs m: Mesh
# ---------- explodemesh: Python ----------
import Rhino.Geometry as rg

ghenv.Component.Message = "explode mesh"

exploded = []

for i in range(m.Faces.Count):
    m_copy = m.Duplicate()
    face = m_copy.Faces.ExtractFaces([i])
    exploded.append(face)
    
a = exploded
# ---------- end explodemesh ----------
hops = Hops(
    _Path=concat_2,
    InputMesh=clean,
    FaceIndex1=Slider(4, range=0..10),
    FaceIndex2=Slider(4, range=0..10),
    CacheResultsInMemory=True,
    CacheSolveResults=True,
    RemoteDefinitionLocation="http://127.0.0.1:5000/shortestpath",
    RemoteSolveVersion=(0, 1, 0),
    ShowInput_Enabled=False,
    ShowInput_Path=True,
    SynchronousSolve=True)
hops_2 = Hops(
    _Path=concat_3,
    InputMesh=clean,
    Plot=Button(),
    Save=False,
    CacheResultsInMemory=False,
    CacheSolveResults=False,
    RemoteDefinitionLocation="http://127.0.0.1:5000/meshgraph",
    RemoteSolveVersion=(0, 1, 0),
    ShowInput_Enabled=False,
    ShowInput_Path=True,
    SynchronousSolve=True)
hops_3 = Hops(
    _Path=concat,
    InputMesh=loop_start.Data,
    FaceIndex1=number_slider_5,
    FaceIndex2=number_slider_4,
    CacheResultsInMemory=True,
    CacheSolveResults=True,
    RemoteDefinitionLocation="http://127.0.0.1:5000/shortestpath",
    RemoteSolveVersion=(0, 1, 0),
    ShowInput_Enabled=False,
    ShowInput_Path=True,
    SynchronousSolve=True)  # disabled
item = ListItem(List=explodemesh.a, Index=hops, Wrap=True)
panel_3 = Panel(hops)
panel_4 = Panel(hops_3)  # disabled
explodemesh_2 = GhPythonScript(m=loop_start.Data, SP=hops_3)  # -> out, a, b, c; inputs m: Mesh, SP: list of Int32; disabled
# ---------- explodemesh_2: Python ----------
import Rhino.Geometry as rg

ghenv.Component.Message = "explode mesh"

exploded = []

for i in range(m.Faces.Count):
    m_copy = m.Duplicate()
    face = m_copy.Faces.ExtractFaces([i])
    exploded.append(face)
    
a = exploded

allFaces = range(len(exploded))

strippedFaces = []
for f in allFaces:
    if f not in SP :
        strippedFaces.append(f)


b = strippedFaces
# ---------- end explodemesh_2 ----------
item_2 = ListItem(List=explodemesh_2.a, Index=hops_3, Wrap=True)  # disabled
clean_3 = CombineClean(Meshes=flatten(item_2))  # disabled
rec = DataRecorder(clean_3, DataLimit=-10, RecordData=False)  # disabled
python_2 = GhPythonScript(M=rec)  # -> out, a; inputs M: Mesh; disabled; same code as python
item_3 = ListItem(List=explodemesh_2.a, Index=explodemesh_2.b, Wrap=True)  # disabled
clean_4 = CombineClean(Meshes=item_3)  # disabled
python_3 = GhPythonScript(M=clean_4)  # -> out, a; inputs M: Mesh; disabled; same code as python
ma = MassAddition(Input=flatten(python_2.a))  # -> Result, PartialResults; disabled
ma_2 = MassAddition(Input=flatten(python_3.a))  # -> Result, PartialResults; disabled
python_4 = GhPythonScript(x=clean_4)  # -> out, a; inputs x: Mesh; disabled
# ---------- python_4: Python ----------
import Rhino.Geometry as rg

m = x.ExplodeAtUnweldedEdges()

a = m
# ---------- end python_4 ----------
addition = Addition(A=ma_2.Result, B=ma.Result)  # disabled
panel_5 = Panel(python_2.a)  # disabled
panel_6 = Panel(ma.Result)  # disabled
loop_end = LoopEnd(port=loop_start.port, Exit=False, Data=python_4.a, TimeOutVal=0, pausedState=False, state="Constant & Record")  # disabled
