# Grasshopper definition MPDA22_session04_all.gh (Grasshopper 1.0.7)
# plug-ins: Human, Hops, Kangaroo2 Components

number_slider = Slider(20, range=0..100)

close_mesh = Mesh(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)
open_tri = Data(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)

mplane = MeshPlane(
    Boundary={Plane=PlaneXY(0, 0, 0), Size=Domain2(u=-10..10, v=-10..10)},
    WidthCount=number_slider,
    HeightCount=number_slider)  # -> Mesh, Area
open_quad = Data(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)
number_slider_2 = Slider(121, range=0..300)
number_slider_3 = Slider(214, range=0..300)
list = ValueList({"edgeLength", "sameWeight"}, selected="sameWeight")
# all shortest paths
mesh = Mesh(open_tri)
hops = Hops(
    _Path="http://127.0.0.1:5000/meshstripper",
    Mesh=mesh,
    WeightMode=list,
    StartPoint=number_slider_2,
    EndPoint=number_slider_3,
    CacheResultsInMemory=False,
    CacheSolveResults=False,
    RemoteDefinitionLocation="http://127.0.0.1:5000/meshstripper",
    RemoteSolveVersion=(0, 1, 0),
    ShowInput_Enabled=False,
    ShowInput_Path=True,
    SynchronousSolve=True)  # -> ShortestPath, FacesIndex, Lengths
explodemesh = GhPythonScript(m=mesh)  # -> out, a; inputs m: Mesh
# ---------- explodemesh: Python ----------
import Rhino.Geometry as rg

ghenv.Component.Message = "explode mesh"

exploded = []

for i in range(m.Faces.Count):
    m_copy = m.Duplicate()
    face = m_copy.Faces.ExtractFaces([i])
    exploded.append(face)
    
a = exploded
# ---------- end explodemesh ----------
partition = PartitionList(List=hops.FacesIndex, Size=hops.Lengths)
partition_2 = PartitionList(List=hops.ShortestPath, Size=hops.Lengths)
item = ListItem(List=explodemesh.a, Index=partition, Wrap=True)
pline = PolyLine(Vertices=partition_2, Closed=False)
mjoin = MeshJoin(Meshes=item)

strips = Data(mjoin)
path = Data(pline)

unroller = Unroller(Strip=strips, Unroll=1)  # -> flatten(Unrolled)
tstat = TreeStatistics(Tree=partition)  # -> Paths, Length, Count
lng = ListLength(List=unroller)
series = Series(Start=0, Step=1, Count=tstat.Count)
unroller_2 = Unroller(Strip=mjoin, Unroll=1)
gradient = Gradient(
    LowerLimit=0,
    UpperLimit=tstat.Count,
    Parameter=series,
    stops=[0: RGB(0, 98, 0), 0.25: RGB(81, 175, 17), 0.5: RGB(159, 198, 146), 0.75: RGB(170, 235, 41), 1: RGB(221, 255, 53)])
num = Number(lng)
facen = FaceNormals(Mesh=unroller_2)  # -> Centers, Normals
item_2 = ListItem(List=facen.Centers, Index=0, Wrap=True)  # -> Item1, Item
item_3 = ListItem(List=facen.Normals, Index=0, Wrap=True)
galapagos = Galapagos(fitness=num, gene=[number_slider_3, number_slider_2])
jitter = Jitter(List=gradient, Jitter=1, Seed=Slider(4, range=0..10))  # -> Values, Indices
pl = PlaneNormal(Origin=item_2.Item, ZAxis=item_3)
vec2pt = Vector2Pt(PointA=item_2.Item1, PointB=item_2.Item, Unitize=False)  # -> Vector, Length
preview = CustomPreview(Geometry=strips, Material=graft(jitter.Values))
previewlw = CustomPreviewLineweights(Geometry=path, Shader=ColourSwatch(SwatchColor=RGB(0, 255, 187)), Thickness=3, Absolute=False)
align = AlignPlane(Plane=pl, Direction=vec2pt.Vector)  # -> Plane, Angle
lng_2 = ListLength(List=flatten(align.Plane))
series_2 = Series(Start=Slider(10, range=0..10), Step=Slider(3.78, range=0..10), Count=lng_2)
pt = ConstructPoint(XCoordinate=series_2, YCoordinate=0, ZCoordinate=0)
xy = XYPlane(Origin=pt)
prot = RotatePlane(Plane=align.Plane, Angle=Slider(1, range=0..1))
orient = Orient(Geometry=unroller_2, Source=prot, Target=graft(xy))  # -> Geometry, Transform
