# Grasshopper definition MPDA22_session04_min.gh (Grasshopper 1.0.7)
# plug-ins: Human, Hops

number_slider = Slider(20, range=0..100)

close_mesh = Mesh(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)
open_tri = Data(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)

mplane = MeshPlane(
    Boundary={Plane=PlaneXY(0, 0, 0), Size=Domain2(u=-10..10, v=-10..10)},
    WidthCount=number_slider,
    HeightCount=number_slider)  # -> Mesh, Area
open_quad = Data(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)
list = ValueList({"edgeLength", "sameWeight"}, selected="sameWeight")
# all shortest paths
mesh = Mesh(open_tri)
hops = Hops(
    _Path="http://127.0.0.1:5000/meshstripper",
    Mesh=mesh,
    WeightMode=list,
    StartPoint=Slider(121, range=0..300),
    EndPoint=Slider(214, range=0..300),
    CacheResultsInMemory=False,
    CacheSolveResults=False,
    RemoteDefinitionLocation="http://127.0.0.1:5000/meshstripper",
    RemoteSolveVersion=(0, 1, 0),
    ShowInput_Enabled=False,
    ShowInput_Path=True,
    SynchronousSolve=True)  # -> ShortestPath, FacesIndex, Lengths
explodemesh = GhPythonScript(m=mesh)  # -> out, a; inputs m: Mesh
# ---------- explodemesh: Python ----------
import Rhino.Geometry as rg

ghenv.Component.Message = "explode mesh"

exploded = []

for i in range(m.Faces.Count):
    m_copy = m.Duplicate()
    face = m_copy.Faces.ExtractFaces([i])
    exploded.append(face)
    
a = exploded
# ---------- end explodemesh ----------
partition = PartitionList(List=hops.FacesIndex, Size=hops.Lengths)
partition_2 = PartitionList(List=hops.ShortestPath, Size=hops.Lengths)
item = ListItem(List=explodemesh.a, Index=partition, Wrap=True)
pline = PolyLine(Vertices=partition_2, Closed=False)
mjoin = MeshJoin(Meshes=item)

strips = Data(mjoin)
path = Data(pline)

tstat = TreeStatistics(Tree=partition)  # -> Paths, Length, Count
series = Series(Start=0, Step=1, Count=tstat.Count)
gradient = Gradient(
    LowerLimit=0,
    UpperLimit=tstat.Count,
    Parameter=series,
    stops=[0: RGB(0, 98, 0), 0.25: RGB(81, 175, 17), 0.5: RGB(159, 198, 146), 0.75: RGB(170, 235, 41), 1: RGB(221, 255, 53)])
jitter = Jitter(List=gradient, Jitter=1, Seed=Slider(4, range=0..10))  # -> Values, Indices
preview = CustomPreview(Geometry=strips, Material=graft(jitter.Values))
previewlw = CustomPreviewLineweights(Geometry=path, Shader=ColourSwatch(SwatchColor=RGB(0, 255, 187)), Thickness=3, Absolute=False)
